# Grasshopper definition PV_case study_anenome.gh (Grasshopper 1.0.7)
# plug-ins: Pufferfish, GH_CPython, Anemone

# ----
# LHS sampling
panel = Panel("E:\Research\GEG\PV_LHS.db")
toggle = BooleanToggle(False)
gh_cpython = GH_CPython(input=toggle, run=toggle, N="600", db_path=panel)  # -> output; inputs input: list, run: list, N: list, db_path: list
#   port input: [required] - [type = int] - [default = None] Descripe your input here * bullet point. * bullet point
#   port output: indicate your output description here. refers to a new line.
# ---------- gh_cpython: Python ----------
if run:
    
    import random
import sqlite3

def get_sampled_value(val, type_info):
    """根据类型信息对数据进行处理"""
    if type_info == "int":
        return int(round(val))
    elif isinstance(type_info, float):
        # 按照步长取整：例如 0.01 步长
        return round(round(val / type_info) * type_info, 2)
    return val

# 定义参数的约束与类型
# 类型说明: "int" 表示整数, 0.01 表示该精度的浮点数
param_config = [
    {"bounds": (15, 25), "type": "int"},
    {"bounds": (0, 90), "type": "int"},
    {"bounds": (14, 20), "type": "int"},
    {"bounds": (-0.5, -0.44), "type": 0.01}
]

# 1. 修改后的 LHS 采样逻辑
def lhs_sample_custom(n, config):
    samples = []
    for cfg in config:
        low, high = cfg["bounds"]
        type_info = cfg["type"]
        
        step = (high - low) / n
        arr = []
        for j in range(n):
            val = random.uniform(low + j*step, low + (j+1)*step)
            arr.append(get_sampled_value(val, type_info))
        
        random.shuffle(arr)
        samples.append(arr)
    return list(zip(*samples))

# 2. 生成数据
if run:
    data = lhs_sample_custom(N, param_config)

    # 3. 写入数据库
    conn = sqlite3.connect(db_path)
    cursor = conn.cursor()
    cursor.execute('DROP TABLE IF EXISTS pv_samples') # 建议每次运行前清空旧表
    cursor.execute('''CREATE TABLE IF NOT EXISTS pv_samples 
                      (id INTEGER PRIMARY KEY, width INTEGER, angle INTEGER, efficiency INTEGER, temp_coeff REAL)''')
    cursor.executemany("INSERT INTO pv_samples (width, angle, efficiency, temp_coeff) VALUES (?,?,?,?)", data)
    conn.commit()
    conn.close()

    status = "Successfully generated {} samples".format(N)
# ---------- end gh_cpython ----------

# ----
# Paras
width_building = Slider(15, range=15..25)
module_efficiency = Slider(20, range=14..20)
angle_pv = Slider(35, range=0..90)
temperatuur_coefficient = Slider(-0.48, range=-0.5..-0.44)

toggle_2 = BooleanToggle(True)
panel_2 = Panel("1")
data_collected = Data(Tree({0;0}: [1, 2, 3, 4, 5, 6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], {0;1}: [73747.1822, 103963.4086, 81493.68564, 71818.94496, 105612.5771, 105279.3258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], {0;2}: [153368, 152298.4, 148888.8, 148888.8, 150587.2, 158022.4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], {0;3}: [79620.8178, 48334.99143, 67395.11436, 77069.85504, 44974.62287, 52743.07425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], {0;4}: [19, 20, 25, 25, 22, 16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], {0;5}: [40, 50, 53, 12, 51, 60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], {0;6}: [0.15, 0.2, 0.15, 0.17, 0.2, 0.2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], {0;7}: [-0.0045, -0.0047, -0.0045, -0.0049, -0.0045, -0.005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]))

# ---- group: write data into database
toggle_3 = BooleanToggle(False)
gh_cpython_2 = GH_CPython(input=toggle_3, run=toggle_3, resu=data_collected)  # -> output; inputs input: list, run: list, resu: list
#   port input: [required] - [type = int] - [default = None] Descripe your input here * bullet point. * bullet point
#   port output: indicate your output description here. refers to a new line.
# ---------- gh_cpython_2: Python ----------
if run:
    import sqlite3
    import os

    # 1. 路径设置
    db_path = r"E:\Research\GEG\PV_RESU.db"
    dir_path = os.path.dirname(db_path)

    # 确保文件夹存在
    if not os.path.exists(dir_path):
        os.makedirs(dir_path)

    # 2. 连接数据库
    conn = sqlite3.connect(db_path)
    cursor = conn.cursor()

    # 3. 初始化表结构
    # 使用 DROP TABLE 确保每次运行脚本都是“全新写入”，避免 ID 冲突
    cursor.execute('DROP TABLE IF EXISTS resu')

    cursor.execute('''
        CREATE TABLE resu (
            id INTEGER PRIMARY KEY,
            PVGeneration REAL,
            EnergyConsumption REAL,
            Netto REAL,
            Width_Building REAL,
            Angle_PV REAL,
            Module_Efficiency REAL,
            Temperature_Coefficient REAL
        )
    ''')

    # 4. 数据预处理
    # 确保 resu 输入端的 Access 设置为 Tree Access
    # zip(*resu) 会将 8 个分支（列数据）转置为按行排列的元组
    try:
        data_rows = list(zip(*resu))
        
        # 5. 执行批量插入
        if data_rows:
            query = '''INSERT INTO resu (
                id, PVGeneration, EnergyConsumption, Netto, 
                Width_Building, Angle_PV, Module_Efficiency, Temperature_Coefficient
            ) VALUES (?, ?, ?, ?, ?, ?, ?, ?)'''
            
            cursor.executemany(query, data_rows)
            
            # 6. 提交更改
            conn.commit()
            print("Successfully saved {} rows to: {}".format(len(data_rows), db_path))
        else:
            print("Warning: Input 'resu' is empty.")

    except Exception as e:
        print("Error during data processing: {}".format(str(e)))

    finally:
        # 7. 关闭连接（务必放在 finally 块中，确保报错也能正常释放文件句柄）
        conn.close()
# ---------- end gh_cpython_2 ----------

# ----
Z = UnitZ(Factor=Slider(15, range=0..100))

# ----
# Iteration
toggle_4 = BooleanToggle(True)
loop_start = LoopStart(N="300", T=toggle_4, D0="293")  # -> port, Counter, Data, Data_2; disabled
addition = Addition(A=loop_start.Data, B=1)
buffer = TimeBuffer(Data=addition, Ms=15000, UseThread=True)

gh_cpython_3 = GH_CPython(input=toggle_2, run=toggle_2, index=loop_start.Data, db_path=panel)  # -> output, Width_Building, Angle_PV, Module_Efficiency, Temperature_Coefficient; inputs input: list, run: list, index: list, db_path: list
#   port input: [required] - [type = int] - [default = None] Descripe your input here * bullet point. * bullet point
#   port output: indicate your output description here. refers to a new line.
# ---------- gh_cpython_3: Python ----------
import sqlite3

# 输入端说明:
# index: 连入一个 Number Slider (表示要查询的ID)
# db_path: 连入一个 File Path 组件 (指向你的 PV_LHS.db 文件)
# run: 连入一个 Boolean Toggle (控制查询开关)

if run:
    try:
        # 连接数据库
        conn = sqlite3.connect(db_path)
        cursor = conn.cursor()
        
        # SQL 查询语句
        query = "SELECT width, angle, efficiency, temp_coeff FROM pv_samples WHERE id = ?"
        cursor.execute(query, (int(index+1),))
        
        # 获取结果
        row = cursor.fetchone()
        
        if row:
            # 将结果分配给输出变量
            Width_Building = row[0]
            Angle_PV = row[1]
            Module_Efficiency = row[2]
            Temperature_Coefficient = row[3]
            status = "Query Successful"
        else:
            Width_Building = Angle_PV = Module_Efficiency = Temperature_Coefficient = None
            status = "No data found for ID {}".format(index)
            
        conn.close()
    except Exception as e:
        status = "Error: {}".format(str(e))
# ---------- end gh_cpython_3 ----------
addition_2 = Addition(A=loop_start.Data, B=1)
panel_3 = Panel([gh_cpython_3.Width_Building, gh_cpython_3.Angle_PV, gh_cpython_3.Module_Efficiency, gh_cpython_3.Temperature_Coefficient])

# ----
# Switch
list = ValueList({"Slider": 0, "Iteration": 1}, selected="Slider")
filter = StreamFilter(Gate=list, Stream0=module_efficiency, Stream1=gh_cpython_3.Module_Efficiency)
filter_2 = StreamFilter(Gate=list, Stream0=width_building, Stream1=gh_cpython_3.Width_Building)
filter_3 = StreamFilter(Gate=list, Stream0=temperatuur_coefficient, Stream1=gh_cpython_3.Temperature_Coefficient)
filter_4 = StreamFilter(Gate=list, Stream0=angle_pv, Stream1=gh_cpython_3.Angle_PV)

division = Division(A=filter_3, B="100")
division_2 = Division(A=filter, B="100")

# ----
# Geo
panel_4 = Panel("800")
pt = Point(Point(0, 0, 0))
Z_2 = UnitZ(Factor=Slider(10, range=0..10))
number_slider = Slider(0, range=0..10)

# ----
# Data to collect
angle_pv_2 = Integer(filter_4)
module_efficiency_2 = Number(division_2)
temperature_coefficient = Number(division)
width_building_2 = Integer(filter_2)

neg = Negative(Value=angle_pv_2)
division_3 = Division(A=panel_4, B=width_building_2)
rectangle = Rectangle(Plane=PlaneXY(0, 0, 0), XSize=width_building_2, YSize=division_3, Radius=0)  # -> Rectangle, Length
area = Area(Geometry=rectangle.Rectangle)  # -> Area, Centroid

# ---- group: REC
move2pt = MoveToPoint(Geometry=rectangle.Rectangle, PointA=area.Centroid, PointB=pt)  # -> Moved, Vector, Transform

# ----
debrep = DeconstructBrep(Brep=move2pt.Moved)  # -> Faces, Edges, Vertices
item = ListItem(List=debrep.Edges, Index=Slider(1, range=0..10), Wrap=True)
midpt = CurveMiddle(Curve=item)
rectangle_2 = Rectangle(Plane=midpt, XSize=Slider(10, range=0..10), YSize=Slider(7, range=0..10), Radius=0)  # -> Rectangle, Length
debrep_2 = DeconstructBrep(Brep=rectangle_2.Rectangle)  # -> Faces, Edges, Vertices
extr = Extrude(Base=move2pt.Moved, Direction=Z_2)
item_2 = ListItem(List=debrep_2.Edges, Index=number_slider, Wrap=True)
item_3 = ListItem(List=debrep_2.Vertices, Index=number_slider, Wrap=True)
cap = CapHoles(Brep=extr)
midpt_2 = CurveMiddle(Curve=item_2)
move2pt_2 = MoveToPoint(Geometry=rectangle_2.Rectangle, PointA=midpt_2, PointB=item_3)  # -> Moved, Vector, Transform

extr_2 = Extrude(Base=move2pt_2.Moved, Direction=Z)
cap_2 = CapHoles(Brep=extr_2)
sunion = SolidUnion(Breps=flatten([cap, cap_2]))

geo = Geometry(sunion)
debrep_3 = DeconstructBrep(Brep=geo)  # -> Faces, Edges, Vertices
item_4 = ListItem(List=debrep_3.Faces, Index=Slider(7, range=0..12), Wrap=True)
surface_roof = Data(item_4)

# ---- group: Energy
# EUI
roomsolid = HBRoomFromSolid(geo=flatten([cap, cap_2]), conditioned=True)  # -> report, rooms; plug-in component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
toggle_5 = BooleanToggle(True)
intsolid = HBIntersectSolids(rooms=flatten(roomsolid.rooms), run=toggle_5)  # -> int_rooms; plug-in component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
solveadj = HBSolveAdjacency(rooms=flatten(intsolid), run=toggle_5)  # -> report, adj_rooms; plug-in component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
toggle_6 = BooleanToggle(False)
aperturesbyratio = HBAperturesByRatio(
    hb_objs=flatten(solveadj.adj_rooms),
    ratio=Slider(0.3, range=0.3..0.8),
    win_height=Slider(3, range=2..4),
    sill_height="1.0")  # -> report, hb_objs; plug-in component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
model = HBModel(rooms=flatten(aperturesbyratio.hb_objs))  # -> report, model; plug-in component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
toggle_7 = BooleanToggle(True)
path = FilePath("E:\Research\case study\case study 202404\DEU_NI_Hannover.AP.103380_TMYx\DEU_NI_Hannover.AP.103380_TMYx.epw")
vizbytype = HBVisualizeByType(hb_objs=aperturesbyratio.hb_objs)  # -> walls, interior_walls, roofs, ceilings, exterior_floors, interior_floors, air_walls, apertures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; plug-in component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
modeltoosm = HBModelToOSM(model=model.model, epw_file=path, write=toggle_7, run=toggle_7)  # -> report, jsons, osw, osm, idf, sql, zsz, rdd, html; plug-in component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
eui = HBEndUseIntensity(sql=modeltoosm.sql)  # -> eui, eui_end_use, end_uses, gross_floor; plug-in component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
multiplication = Multiplication(A=eui.eui, B=panel_4)

# ----
# PV_Surfaces
number_slider_2 = Slider(25, range=0..100)
offset = OffsetCurve(Curve=surface_roof, Distance=Slider(-1, range=-2..2), Corners=1)
debrep_4 = DeconstructBrep(Brep=offset)  # -> Faces, Edges, Vertices
item_5 = ListItem(List=debrep_4.Edges, Index=Slider(3, range=0..10), Wrap=True)
number_slider_3 = Slider(2, range=0..10)
series = Series(Start=0, Step=number_slider_3, Count=number_slider_2)
Y = UnitY(Factor=series)
move = Move(Geometry=item_5, Motion=Y)  # -> Geometry, Transform
clx = CurveLine(Curve=offset, Line=move.Geometry)  # -> Points, Params, Count
bool = Boolean(clx.Points)
cull = CullPattern(List=clx.Points, CullPattern=bool)
clean = CleanTree(RemoveNulls=True, RemoveInvalid=True, RemoveEmpty=Toggle(True), Tree=cull)
item_6 = ListItem(List=clean, Index=0, Wrap=True)
item_7 = ListItem(List=clean, Index="1", Wrap=True)
ln = Line(StartPoint=item_6, EndPoint=item_7)  # -> flatten(Line)
Z_3 = UnitZ(Factor=number_slider_3)
item_8 = ListItem(List=ln, Index=0, Wrap=True)
flip = FlipCurve(Curve=ln, Guide=item_8)  # -> Curve, Flag
extr_3 = Extrude(Base=flip.Curve, Direction=Z_3)
midpt_3 = CurveMiddle(Curve=flip.Curve)
rot3d = Rotate3D(Geometry=extr_3, Angle=degrees(neg), Center=midpt_3, Axis=flip.Curve)  # -> Geometry, Transform
pv_surfaces = Geometry(rot3d.Geometry)

importepw = LBImportEPW(epw_file=path)  # -> location, dry_bulb_temperature, dew_point_temperature, relative_humidity, wind_speed, wind_direction, direct_normal_rad, diffuse_horizontal_rad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; plug-in component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
flip_2 = Flip(Surface=pv_surfaces)  # -> Surface, Result
panel_5 = Panel([eui.eui, eui.eui_end_use, eui.end_uses])

# ----
# PV power generation
skymatrix = LBCumulativeSkyMatrix(location=importepw.location, direct_rad=importepw.direct_normal_rad, diffuse_rad=importepw.diffuse_horizontal_rad)  # -> report, sky_mtx; plug-in component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
context = Geometry([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])

# ----
# Power = Radiation × Area × Efficiency × (1 + temp_coeff × ΔT) × 0.9
incidentradiation = LBIncidentRadiation(sky_mtx=skymatrix.sky_mtx, geometry=flatten(flip_2.Surface), grid_size=Slider(1, range=0..10), run=Toggle(True))  # -> report, points, results, total, mesh, legend, title, int_mtx; plug-in component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

msh2psrf = MeshToPolysurface(Mesh=incidentradiation.mesh, Triangles=False, FaceMerge=False)
debrep_5 = DeconstructBrep(Brep=msh2psrf)  # -> Faces, Edges, Vertices
area_2 = Area(Geometry=debrep_5.Faces)  # -> Area, Centroid
expression = Expression(
    x=incidentradiation.results,
    y=area_2.Area,
    z=module_efficiency_2,
    u=temperature_coefficient,
    Expression="x*y*z*(1+u*20)*0.9")
ma = MassAddition(Input=expression)  # -> Result, PartialResults

subtraction = Subtraction(A=multiplication, B=ma.Result)

entwine = Entwine(
    Branch00=addition_2,
    Branch01=ma.Result,
    Branch02=multiplication,
    Branch03=subtraction,
    Branch04=width_building_2,
    Branch05=angle_pv_2,
    Branch06=module_efficiency_2,
    Branch07=temperature_coefficient,
    FlattenInputs=True)

merge = Merge(Data1=loop_start.Data_2, Data2=entwine)
running = Running(port=loop_start.port, Exit=False, Data=buffer, Data_2=merge, TimeOutVal=0, pausedState=False, state="Constant output")  # -> D0, D1

# ---- group: double check
area_3 = Area(Geometry=flip_2.Surface)  # -> Area, Centroid
ma_2 = MassAddition(Input=area_2.Area)  # -> Result, PartialResults
ma_3 = MassAddition(Input=area_3.Area)  # -> Result, PartialResults
panel_6 = Panel(ma_3.Result)
panel_7 = Panel(ma_2.Result)
